# Grasshopper definition 3d_printer_final.gh (Grasshopper 1.0.8)

brep = Brep([<brep referenced from the Rhino model> x642])
py3 = Python3Script(breps=brep)  # -> out, bounding_fit_breps, bounding_breps, non_solids; inputs breps: list of GeometryBase
# ---------- py3: Python ----------
from dataclasses import dataclass, field
import ghpythonlib.components as ghc
import ghpythonlib.parallel as ghp
import Rhino.Geometry as rg
import math
import time

@dataclass
class FitBrep:
    ANGLES = [i * math.pi / 180 for i in range(0, 180, 10)]
    ROTATED_PLANES = [ghc.Rotate(rg.Plane.WorldXY, angle, rg.Plane.WorldXY)[0] for angle in ANGLES]
    
    brep: rg.GeometryBase
    brep_num: int
    bounding_box: rg.Brep = field(init=False)
    base_plane: rg.Plane = field(init = False)

    upper_srf : rg.Surface = field(init = False)
    upper_pt : rg.Point3d = field(init = False)
    upper_plane: rg.Plane = field(init=False)

    lower_srf : rg.Surface = field(init = False)
    lower_pt: rg.Surface = field(init = False)
    lower_plane: rg.Plane = field(init=False)

    def __post_init__(self):
        min_volume = 1E18
        best_plane = None
        best_bbox = None
        for rotated_plane in FitBrep.ROTATED_PLANES:
            bbox_result = ghc.BoundingBox(self.brep, rotated_plane)[0]
            volume = bbox_result.Volume
            if volume < min_volume:
                min_volume = volume
                best_plane = rotated_plane
                best_bbox = bbox_result
        self.bounding_box = best_bbox.ToBrep()
        decon = ghc.DeconstructBrep(self.bounding_box)
        faces = decon[0]
        sorted_faces = sorted(faces, key=lambda face: rg.AreaMassProperties.Compute(face).Centroid.Z)
        self.upper_srf = sorted_faces[-1]
        self.lower_srf = sorted_faces[0]

        self.upper_pt = rg.AreaMassProperties.Compute(self.upper_srf).Centroid
        self.lower_pt = rg.AreaMassProperties.Compute(self.lower_srf).Centroid

        self.upper_plane = ghc.PlaneOrigin(best_plane, self.upper_pt)
        self.lower_plane = ghc.PlaneOrigin(best_plane, self.lower_pt)

        self.base_plane = ghc.PlaneOrigin(rg.Plane.WorldXY, self.upper_pt)


solids = []       
non_solids = []   

start_time = time.time()
for b in breps:
    if isinstance(b, rg.Brep):
        if b.IsSolid:
            solids.append(b)
        else:
            non_solids.append(b)
print("Filtered breps count: ", len(solids))
print("Filtered non_breps count: ", len(non_solids))
end_time = time.time()
print("Total processing time: {:.2f} seconds".format(end_time - start_time))

Geo = list(enumerate(solids))
start_time = time.time()
fit_breps_parallel = ghp.run(lambda x : FitBrep(x[1], x[0]), Geo, True)
end_time = time.time()
print("Total processing time: {:.2f} seconds".format(end_time - start_time))

start_time = time.time()
bounding_fit_breps = list(fit_breps_parallel)
bounding_breps = [fit_brep.bounding_box for fit_brep in bounding_fit_breps]
end_time = time.time()
print("Total processing time: {:.2f} seconds".format(end_time - start_time))
# ---------- end py3 ----------
py3_2 = Python3Script(
    bounding_fit_breps=py3.bounding_fit_breps,
    font="Tahoma",
    font_height=Slider(3.9, range=0..10),
    font_space=Slider(0.1, range=0..10))  # -> out, builds_legend, bounding_fit_breps; inputs bounding_fit_breps: list, font: String, font_height: Double, font_space: Double
# ---------- py3_2: Python ----------
import Rhino.Geometry as rg
import Rhino
import ghpythonlib.components as ghc
import ghpythonlib.treehelpers as th
import ghpythonlib.parallel as ghp  
import scriptcontext as sc
import System.Drawing as sd

bfb = bounding_fit_breps
builds_legend = []

font = font  
font_height = font_height  
font_space = font_space

def CreateSolidText(text, font, plane, h, space):
    text_entity = rg.TextEntity()
    text_entity.Plane = plane
    text_entity.PlainText = text  
    text_entity.Justification = rg.TextJustification.MiddleCenter
    text_entity.TextHeight = float(h)
    font_index = Rhino.RhinoDoc.ActiveDoc.Fonts.FindOrCreate(font, False, False)
    if font_index == -1:
        font_index = Rhino.RhinoDoc.ActiveDoc.Fonts.FindOrCreate("Arial", False, False)
    text_entity.FontIndex = font_index
    text_surfaces = text_entity.CreateSurfaces(text_entity.DimensionStyle, False, spacing=space)
    return text_surfaces

def ProcessBrep(fb):
    bbox = fb.bounding_box
    text = str(fb.brep_num)
    plane = fb.base_plane
    retSurfs = list(CreateSolidText(text, font, plane, font_height, font_space))
    return retSurfs


builds_legend = list(ghp.run(ProcessBrep, bfb, False))
builds_legend = th.list_to_tree(builds_legend)
bounding_fit_breps = bounding_fit_breps
# ---------- end py3_2 ----------
py3_3 = Python3Script(find_num=Slider(257, range=0..1000))  # -> out, result; inputs bounding_fit_breps: list, find_num: Int32
# ---------- py3_3: Python ----------
bfb = bounding_fit_breps
num = find_num

result = None

for fb in bfb:
    if fb.brep_num == num:
        result = fb.brep
        break

if result is None:
    raise Exception("찾을 수 없음.")
# ---------- end py3_3 ----------
list = ValueList({"1:1": 1, "1:10": 10, "1:30": 10, "1:50": 50, "1:100": 100, "1:200": 200, "1:300": 300, "1:400": 400, "1:500": 500, "1:600": 600, "1:700": 700, "1:800": 800, "1:900": 900, "1:1000": 1000, "1:1500": 1500, "1:2000": 2000}, selected="1:1000")
list_2 = ValueList({"1:1": 1, "1:10": 10, "1:30": 10, "1:50": 50, "1:100": 100, "1:200": 200, "1:300": 300, "1:400": 400, "1:500": 500, "1:600": 600, "1:700": 700, "1:800": 800, "1:900": 900, "1:1000": 1000, "1:1500": 1500, "1:2000": 2000}, selected="1:700")
pt = Point(Point(219.4867821, -680.7619935, 0))
py3_4 = Python3Script(
    run=Toggle(True),
    start_point=pt,
    bounding_fit_breps=py3_2.bounding_fit_breps,
    printer_panel_x=Slider(230, range=0..1000),
    printer_panel_y=Slider(230, range=0..1000),
    now_scale=list,
    goal_scale=list_2,
    interval=Slider(2, range=0..10),
    font="Tahoma",
    font_height=Slider(3.4, range=0..10),
    font_space=Slider(0.1, range=0..10))  # -> out, outline, parts, parts_num; inputs start_point: Point3d, bounding_fit_breps: list
# ---------- py3_4: Python ----------
from dataclasses import dataclass, field, replace
from typing import List, Tuple
import ghpythonlib.components as ghc
import ghpythonlib.treehelpers as th
import Rhino.Geometry as rg
import math
import System.Drawing as sd
import random
import Rhino
import time

@dataclass
class Rectangle:
    width: float
    height: float
    base_num: int
    x: float = field(default=None)
    y: float = field(default=None)
    area: float = field(init=False)

    def __post_init__(self):
        self.area = self.width * self.height

    @staticmethod
    def is_overlap(rect1: "Rectangle", rect2: "Rectangle") -> bool:
        if rect1.x is None or rect2.x is None:
            return False
        if rect1.x + rect1.width <= rect2.x or rect2.x + rect2.width <= rect1.x:
            return False
        if rect1.y + rect1.height <= rect2.y or rect2.y + rect2.height <= rect1.y:
            return False
        return True

    @classmethod
    def clone_with_position(cls, rect: "Rectangle", x: float, y: float) -> "Rectangle":
        new_obj = cls.__new__(cls)
        new_obj.width = rect.width
        new_obj.height = rect.height
        new_obj.base_num = rect.base_num
        new_obj.x = x
        new_obj.y = y
        new_obj.area = rect.area
        return new_obj

class PackingSolver:

    def __init__(self, container_width: float, container_height: float, rectangles: List[Rectangle]):
        self.container_width = container_width
        self.container_height = container_height
        self.rectangles = rectangles
        self.container_area = self.calculate_container_area()

    def calculate_container_area(self) -> float:
        return self.container_width * self.container_height

    def calculate_total_parts_area(self) -> float:
        return sum(rect.area for rect in self.rectangles)

    @staticmethod
    def bottom_left_fill(rectangles: List[Rectangle], container_width: float, container_height: float) -> List[Rectangle]:
        placed = []
        candidate_cache = {(0, 0)}
        for rect in rectangles:
            best_candidate = None
            best_y = container_height + 1
            feasible_candidates = [(cx, cy) for (cx, cy) in candidate_cache 
                                if cx + rect.width <= container_width and cy + rect.height <= container_height]
            if not feasible_candidates:
                rect.x, rect.y = None, None
                continue

            for (cx, cy) in feasible_candidates:
                temp_rect = Rectangle.clone_with_position(rect, cx, cy)
                valid = True
                for other in placed:
                    if Rectangle.is_overlap(temp_rect, other):
                        valid = False
                        break
                if valid:
                    if cy < best_y or (cy == best_y and cx < (best_candidate[0] if best_candidate else container_width)):
                        best_candidate = (cx, cy)
                        best_y = cy
            if best_candidate is None:
                rect.x, rect.y = None, None
            else:
                rect.x, rect.y = best_candidate
                placed.append(rect)
                candidate_cache.add((rect.x + rect.width, rect.y))
                candidate_cache.add((rect.x, rect.y + rect.height))
        return placed



    @staticmethod
    def to_rhino_polylines(placed_rectangles: List[Rectangle], container_width: float, container_height: float, cache: dict) -> Tuple[rg.Polyline, List[rg.Brep]]:
        container_interval_x = rg.Interval(0, container_width)
        container_interval_y = rg.Interval(0, container_height)
        container_rect = rg.Rectangle3d(rg.Plane.WorldXY, container_interval_x, container_interval_y)
        container_poly = container_rect.ToPolyline()
        rect_brep = []
        rect_num = []
        rect_plane = []
        for rect in placed_rectangles:
            if rect.x is None or rect.y is None: continue
            mid_pt = rg.Point3d(rect.width/2 + rect.x, rect.y + rect.height/2, 0)
            orient_brep = ghc.Orient(cache[rect.base_num], rg.Point3d(0, 0, 0), mid_pt)[0]
            rect_brep.append(orient_brep)
            rect_num.append(rect.base_num)

            base_plane = ghc.PlaneOrigin(rg.Plane.WorldXY, mid_pt)
            rect_plane.append(base_plane)
        return container_poly, rect_brep, rect_num, rect_plane


def partition_by_total_area(rectangles: List[Rectangle], target_area: float) -> List[List[Rectangle]]:
    groups = []
    current_group = []
    current_sum = 0.0
    for rect in rectangles:       
        if current_sum + rect.area <= target_area:
            current_group.append(rect)
            current_sum += rect.area
        else:
            if current_group:
                groups.append(current_group)
            current_group = [rect]
            current_sum = rect.area
    if current_group:
        groups.append(current_group)
    return groups

def nxt_pt(pt, nx):
    new_point = rg.Point3d(pt.X + nx, pt.Y, pt.Z)     
    return new_point

def move_geo(geo, cur_pt):
    vec = rg.Vector3d(cur_pt - rg.Point3d.Origin)
    res = []
    for i in geo:
        new_geo = ghc.Move(i, vec)[0]
        res.append(new_geo)
    return res

def CreateSolidText(text, font, plane, h, space):
    text_entity = rg.TextEntity()
    text_entity.Plane = plane
    text_entity.PlainText = text  
    text_entity.Justification = rg.TextJustification.MiddleCenter
    text_entity.TextHeight = float(h)
    font_index = Rhino.RhinoDoc.ActiveDoc.Fonts.FindOrCreate(font, False, False)
    if font_index == -1:
        font_index = Rhino.RhinoDoc.ActiveDoc.Fonts.FindOrCreate("Arial", False, False)
    text_entity.FontIndex = font_index
    text_surfaces = text_entity.CreateSurfaces(text_entity.DimensionStyle, False, spacing=space)
    return text_surfaces



if __name__ == "__main__":
    boxes = []
    scale = 1.0 * now_scale / goal_scale
    base_plane = rg.Plane.WorldXY
    base_pos = rg.Point3d(0, 0, 0)
    brep_dict = {}
    if not run: 
        exit()

    for fb in bounding_fit_breps:
        orientxy_srf = ghc.Orient(fb.lower_srf, fb.lower_plane, rg.Plane.WorldXY)[0]
        orientxy_brep = ghc.Orient(fb.brep, fb.lower_plane, rg.Plane.WorldXY)[0]
        fb_num = fb.brep_num
        bbox = orientxy_srf.GetBoundingBox(rg.Plane.WorldXY)
        w = bbox.Max.X - bbox.Min.X 
        h = bbox.Max.Y - bbox.Min.Y 
        new_brep = ghc.Scale(orientxy_brep, rg.Point3d(0, 0, 0), scale)[0]
        box = Rectangle(
            width = w * scale + interval,
            height = h * scale + interval,
            base_num = fb_num,
        )
        brep_dict[fb_num] = new_brep
        boxes.append(box)

    random.shuffle(boxes)
    start = time.time()
    container_width = printer_panel_x
    container_height = printer_panel_y

    groups = partition_by_total_area(boxes, printer_panel_x * printer_panel_y)
    cur_pt = rg.Point3d(start_point.X, start_point.Y, start_point.Z)
    outline = []
    parts = []
    parts_num = []
    
    for group in groups[:-1]:
        sorted_rects = sorted(group, key=lambda r: r.area, reverse=True)
        initial_placement = PackingSolver.bottom_left_fill(sorted_rects, container_width, container_height)
        container_poly, rect_polylines, rect_num, rect_plane = PackingSolver.to_rhino_polylines(
            initial_placement, container_width, container_height, brep_dict)
        outline.append(move_geo([container_poly], cur_pt))
        parts.append(move_geo(rect_polylines, cur_pt))
        text_num = []
        for idx, j in enumerate(rect_num):
            text_surfaces = list(CreateSolidText(str(j), font, rect_plane[idx], font_height, font_space))
            text_num.extend(move_geo(text_surfaces, cur_pt))
            if j in brep_dict:
                del brep_dict[j]
        parts_num.append(text_num)
        cur_pt = nxt_pt(cur_pt, printer_panel_x + 100)
    
    max_attempts = 3 
    attempt = 0
    while brep_dict and attempt < max_attempts:
        attempt += 1
        print(f"재배치 시도 {attempt}: 남은 사각형 수 = {len(brep_dict)}")
        # 남은 사각형들을 원래 전체 목록(boxes)에서 딕셔너리에 남아있는 base_num을 가진 객체들로 재구성
        remaining_rects = [rect for rect in boxes if rect.base_num in brep_dict]
        # 컨테이너 면적에 따라 그룹화
        groups = partition_by_total_area(remaining_rects, printer_panel_x * printer_panel_y)
        for group in groups:
            sorted_rects = sorted(group, key=lambda r: r.area, reverse=True)
            placement = PackingSolver.bottom_left_fill(sorted_rects, container_width, container_height)
            container_poly, rect_polylines, rect_num, rect_plane = PackingSolver.to_rhino_polylines(
                placement, container_width, container_height, brep_dict)
            outline.append(move_geo([container_poly], cur_pt))
            parts.append(move_geo(rect_polylines, cur_pt))
            text_num = []
            for idx, j in enumerate(rect_num):
                text_surfaces = list(CreateSolidText(str(j), font, rect_plane[idx], font_height, font_space))
                text_num.extend(move_geo(text_surfaces, cur_pt))
                if j in brep_dict:
                    del brep_dict[j]
            parts_num.append(text_num)
            cur_pt = nxt_pt(cur_pt, printer_panel_x + 100)
    
    outline = th.list_to_tree(outline)
    parts = th.list_to_tree(parts)
    parts_num = th.list_to_tree(parts_num)

    end = time.time()
    print("총 소요 시간:", end - start)
# ---------- end py3_4 ----------
crv = Curve(py3_4.outline)
brep_2 = Brep(py3_4.parts)
srf = Surface(py3_4.parts_num)
